# Grasshopper definition GH_python_remote_sticky.ghx (Grasshopper 0.9.76)
# plug-ins: Python Interpreter

# Turn me on!   -->
python = PythonScript()  # -> GH_to_python_sticky_path
# ---------- python: Python ----------
import ghpythonremote
import inspect
from os import path

ROOT = path.abspath(path.dirname(inspect.getfile(ghpythonremote)))
GH_to_python_sticky_path = path.join(ROOT, 'examples', 'GH_to_python_sticky.py')
# ---------- end python ----------

# ---- group: Import remote python modules
# GH to python remote example.
# Pierre Cuvilliers, 2017
# Released under the GNU AGPL license
# github.com/pilcru/ghpythonremote
# Runs and connects to an external python engine, and assigns imported modules to scriptcontext.sticky variables.
# 
# Arguments:
#     code (str): Path to the GH_to_python_sticky.py code file.
#     env_name (str): The name of the Anaconda virtual environment to use to run the external python engine.
#     run (boolean): Creates the connection, and imports new modules, when turned to True. Kills the connection, and deletes the references to the imports, when turned to False.
#     modules (str list): List of module names to import in the remote python. They will be added to the scriptcontext.sticky dictionnary, allowing them to be reused from other python components in the same Grasshopper document.
# 
# Returns:
#     out (str): Console output with DEBUG information.
#     linked_modules (str list): list of imported module names.
panel = Panel(python)
panel_2 = Panel("""numpy
scipy""")
file = ReadFile(F=panel, PerLineParse=False)  # -> C
#   port F: Uri of file to read
# ---------- file: VB line parser ----------
    action = GH_LineParserAction.Include
    Return line

    'Parse the line and return some data that represents the line.
    'If the line cannot be parsed, you can return Nothing and
    'assign a different action.
    'The default implementation is to just return the line itself.
    'If you return types that implement IGH_Goo, this component
    'will work substantially faster.
# ---------- end file ----------
python_2 = PythonScript(Code=file, Env_name="py27", Run=Toggle(False), Modules=panel_2)  # -> Out, Linked_modules
panel_3 = Panel(python_2.Out)

# ---- group: Use numpy
python_3 = PythonScript()  # -> out, a
# ---------- python_3: Python ----------
import scriptcontext
np = scriptcontext.sticky['numpy']
# Do some stuff
a = np.arange(15).reshape(3, 5)
print(a)
# ---------- end python_3 ----------
